# Dynamo graph Home.dyn (Dynamo 0.9.0.3067)

today = DateTime.Today()
minValue = DateTime.MinValue()
daysInMonthwerwerwerwerwerwerwer = DateTime.DaysInMonth(today, minValue)  # "DateTime.DaysInMonthwerwerwerwerwerwerwer"
python_script = Python()  # starter script, not edited (OUT = 0)
code_block = CodeBlock { nigger code; dedfrefwfewfewfwefwefwefwefwefwefwef; }
