# Dynamo custom node Котина.dyf (Dynamo 0.9.0.3067)
# category: BuiltIn
# Скотина

python_script = Python()
# ---------- python_script.python (9 lines) ----------
import clr
clr.AddReference('ProtoGeometry')
from Autodesk.DesignScript.Geometry import *
#Введенные в этом узле данные сохраняется в виде списка в переменных IN.
dataEnteringNode = IN

#Назначьте вывод переменной OUT.
OUT = 0
huihuihu
# ----------------------------------------
byDate = DateTime.ByDate(python_script, python_script, python_script)
