# Dynamo graph Экспорт-изображения-PNG.dyn (Dynamo 0.9.0.3067)

boolean = BoolSelector(true)
котина = Custom[Котина]()  # Скотина
python_script = Python(IN[0]=boolean, IN[1]=котина)
# ---------- python_script.python (35 lines) ----------
import clr
clr.AddReference('System.Windows.Forms')
from System.Windows.Forms import *
clr.AddReference('RevitAPI')
import Autodesk
from Autodesk.Revit.DB import *

clr.AddReference('RevitAPIUI')
import Autodesk
from Autodesk.Revit.UI import *

clr.AddReference("RevitServices")
import RevitServices
from RevitServices.Persistence import DocumentManager
from RevitServices.Transactions import TransactionManager

doc = DocumentManager.Instance.CurrentDBDocument
uidoc=DocumentManager.Instance.CurrentUIApplication.ActiveUIDocument
uiapp=DocumentManager.Instance.CurrentUIApplication
app = uiapp.Application

window = SaveFileDialog()
window.Title = 'Сохранить скриншот PNG'
window.Filter = 'PNG files (*.PNG)|*.PNG'
if window.ShowDialog() == DialogResult.OK:
	options = ImageExportOptions()
	options.ExportRange = ExportRange.VisibleRegionOfCurrentView
	options.FilePath = window.FileName
	options.HLRandWFViewsFileType = ImageFileType.PNG # тип можно выбрать любой
	options.ImageResolution = ImageResolution.DPI_150 # разрешение можно изменить DPI_150 DPI_300 DPI_600
	options.ZoomType = ZoomFitType.Zoom
	options.ShadowViewsFileType = ImageFileType.PNG
	doc.ExportImage(options)
	
# СПАСИБО МИХАИЛУ ДУБКО!
# ----------------------------------------
